# Grasshopper definition CBDM - Assignment 01 - Khalifah - Hops.gh (Grasshopper 1.0.8)
# plug-ins: Pufferfish

radius = Slider(0.25, range=0.25..2)
# Single unit
# Shade - Beam
hight = Slider(5, range=5..7.5)
silhouette = Slider(2.5, range=0.1..2.5)
radius_2 = GetNumber(radius, AtLeast=1, AtMost=1, Maximum=1.797693135e+308, Minimum=-1.797693135e+308, TreeAccess=False)
hight_2 = GetNumber(hight, AtLeast=1, AtMost=1, Maximum=1.797693135e+308, Minimum=-1.797693135e+308, TreeAccess=False)
silhouette_2 = GetNumber(silhouette, AtLeast=1, AtMost=1, Maximum=1.797693135e+308, Minimum=-1.797693135e+308, TreeAccess=False)

major_axis = Slider(5, range=5..15)
minor_axis = Slider(3, range=3..10)
# Shade - Top
thickness = Slider(0.1, range=0.1..1)

major = GetInteger(major_axis, AtLeast=1, AtMost=1, Maximum=2147483647, Minimum=-2147483648, TreeAccess=False)
minor = GetInteger(minor_axis, AtLeast=1, AtMost=1, Maximum=2147483647, Minimum=-2147483648, TreeAccess=False)
thickness_2 = GetNumber(thickness, AtLeast=1, AtMost=1, Maximum=1.797693135e+308, Minimum=-1.797693135e+308, TreeAccess=False)
y_coordinate = Slider(0, range=-5..5)
Y = GetInteger(y_coordinate, AtLeast=1, AtMost=1, Maximum=2147483647, Minimum=-2147483648, TreeAccess=False)

# ----
# Array unit
# Shade - Array
count = Slider(1, range=1..5)
distance_from_center = Slider(0, range=-10..0)

count_2 = GetInteger(count, AtLeast=1, AtMost=1, Maximum=2147483647, Minimum=-2147483648, TreeAccess=False)
distance = GetInteger(distance_from_center, AtLeast=1, AtMost=1, Maximum=2147483647, Minimum=-2147483648, TreeAccess=False)

unit_z = UnitZ(Factor=hight_2)
plane = Plane(PlaneXY(0, 0, 0))
move = Move(Geometry=plane, Motion=unit_z)  # -> Geometry, Transform
point = Point(Point(0.2681794133, 0, 0))
ellipse = Ellipse(Plane=move.Geometry, Radius1=major, Radius2=minor)  # -> Ellipse, Focus1, Focus2
circle_cnr = CircleCNR(Center=point, Normal=Vector(0, 0, 1), Radius=radius_2)
area = Area(Geometry=circle_cnr)  # -> Area, Centroid
area_2 = Area(Geometry=ellipse.Ellipse)  # -> Area, Centroid
line = Line(StartPoint=area.Centroid, EndPoint=area_2.Centroid)
end_points = EndPoints(Curve=line)  # -> Start, End
unit_z_2 = UnitZ(Factor=silhouette_2)
move_2 = Move(Geometry=end_points.Start, Motion=unit_z_2)  # -> Geometry, Transform
unit_z_3 = UnitZ(Factor=thickness_2)
circle_cnr_2 = CircleCNR(Center=move_2.Geometry, Normal=Vector(0, 0, 1), Radius=radius_2)
extrude = Extrude(Base=ellipse.Ellipse, Direction=unit_z_3)
cap_holes = CapHoles(Brep=extrude)

# ----
# Shade - Base
x_coordinate = Slider(0, range=-5..5)

X = GetInteger(x_coordinate, AtLeast=1, AtMost=1, Maximum=2147483647, Minimum=-2147483648, TreeAccess=False)

construct_point = ConstructPoint(XCoordinate=X, YCoordinate=Y, ZCoordinate="0")

point_2 = Point(construct_point)
move_to_point = MoveToPoint(Geometry=[circle_cnr_2, circle_cnr], PointA=point, PointB=point_2)  # -> Moved, Vector, Transform
merge = Merge(Data2=ellipse.Ellipse, Data3=move_to_point.Moved)
loft = Loft(Curves=merge, Options={Adjust=False, Closed=False, LoftEnds=0, LoftSimp=0, LoftType=0, Rebuild=10, Refit=0.01})
cap_holes_2 = CapHoles(Brep=loft)

geometry = Geometry([cap_holes_2, cap_holes])

bounding_box = BoundingBox(Content=geometry, Plane=PlaneXY(0, 0, 0), UnionBox=True)  # -> Box, Box_2
deconstruct_brep = DeconstructBrep(Brep=bounding_box.Box)  # -> Faces, Edges, Vertices
list_item = ListItem(List=deconstruct_brep.Edges, Index=0, Wrap=True)  # -> Item, Item1, Item2, Item3
unit_x = UnitX(Factor=distance)
move_3 = Move(Geometry=list_item.Item3, Motion=unit_x)  # -> Geometry, Transform
curve_middle = CurveMiddle(Curve=move_3.Geometry)
circle_cnr_3 = CircleCNR(Center=curve_middle, Normal=Vector(0, 0, 1), Radius=1)
area_3 = Area(Geometry=circle_cnr_3)  # -> Area, Centroid
plane_origin = PlaneOrigin(Base=area_3.Centroid, Origin=area_3.Centroid)
polar_array = PolarArray(Geometry=geometry, Plane=plane_origin, Count=count_2, Angle=6.283185307)  # -> Geometry, Transform

# ----
# Array scale unit
panel = Panel("1")
subtraction = Subtraction(A=count_2, B=panel)
construct_domain = ConstructDomain(DomainStart=panel, DomainEnd=subtraction)
range = Range(Domain=construct_domain, Steps=count_2)
list_item_2 = ListItem(List=range, Index=0, Wrap=Toggle(False))  # -> Item, Item1, Item2, Item3, Item4
list_item_3 = ListItem(List=polar_array.Geometry, Index=0, Wrap=Toggle(False))  # -> Item, Item1, Item2, Item3, Item4
scale_nu = ScaleNU(Geometry=list_item_3.Item1, Plane=PlaneXY(0, 0, 0), ScaleX=1, ScaleY=1, ScaleZ=list_item_2.Item1)  # -> Geometry, Transform
scale_nu_2 = ScaleNU(Geometry=list_item_3.Item2, Plane=PlaneXY(0, 0, 0), ScaleX=1, ScaleY=1, ScaleZ=list_item_2.Item2)  # -> Geometry, Transform
scale_nu_3 = ScaleNU(Geometry=list_item_3.Item3, Plane=PlaneXY(0, 0, 0), ScaleX=1, ScaleY=1, ScaleZ=list_item_2.Item3)  # -> Geometry, Transform
scale_nu_4 = ScaleNU(Geometry=list_item_3.Item4, Plane=PlaneXY(0, 0, 0), ScaleX=1, ScaleY=1, ScaleZ=list_item_2.Item4)  # -> Geometry, Transform

merge_2 = Merge(Data1=geometry, Data2=scale_nu.Geometry, Data3=scale_nu_2.Geometry, Data4=scale_nu_3.Geometry, Data5=scale_nu_4.Geometry)  # -> flatten(Result)
geometry_2 = Geometry(merge_2)
context_bake = ContextBake(ShadeStructure=geometry_2)
