# Grasshopper definition Hops Component File.gh (Grasshopper 1.0.8)
# plug-ins: Hops

# People
mesh = Mesh([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])
# Shade - Top
silhouette = Slider(0.1, range=0.1..2.5)
# Shade - Beam
hight = Slider(5, range=5..7.5)
radius = Slider(0.5, range=0.25..2)
# Shade - Base
thickness = Slider(0.2, range=0.1..1)
x_coordinate = Slider(2, range=-5..5)
# Shade - Array
y_coordinate = Slider(-1, range=-5..5)
count = Slider(3, range=1..5)
distance_from_center = Slider(-1, range=-10..0)
major_axis = Slider(7, range=5..15)
minor_axis = Slider(6, range=3..10)
hops = Hops(
    Hight=hight,
    Radius=radius,
    Silhouette=silhouette,
    Major=major_axis,
    Minor=minor_axis,
    Thickness=thickness,
    X=x_coordinate,
    Y=y_coordinate,
    Count=count,
    Distance=distance_from_center,
    CacheResultsInMemory=True,
    CacheSolveResults=True,
    RemoteDefinitionLocation="C:\Users\User\Desktop\CBDM - Assignment 01 - Khalifah\bimsc25-datamgmt-session01\CBDM - Assignment 01 - Khalifah - Hops.gh",
    RemoteSolveVersion=(0, 1, 0),
    ShowInput_Enabled=False,
    ShowInput_Path=False,
    SynchronousSolve=True)
custom_preview = CustomPreview(Geometry=hops, Material=ColourSwatch(SwatchColor=RGB(191, 219, 201)))
